% Simulink data dictionary myNewDictionary.sldd

Sig = Simulink.Signal(DataType="uint8")

myColors = enum(HeaderFile="colorsType.h", DefaultValue="Cyan")  % These are my favorite colors.
  Orange = 1
  Black = 2
  Cyan = 3

Param = Simulink.Parameter(myColors.Black, DataType="Enum: myColors")